# Requirement set f16a_logical_derived (R2026b)
Design-decision requirements for the three F-16A logical roles whose realization is undecided. A role with more than one credible realization is an open question rather than a settled part (D-002): the question is recorded at L, and the decision is taken at P, where the candidates carry numbers (D-001). Three Physical-layer trade studies (physical/F16AEngineTradeStudy.m, F16AFlightControlsTradeStudy.m and F16AAirframeTradeStudy.m) score the concrete parameterized candidates and answer one each.

## 1 [REQ_F16A_LOGICAL] F-16A logical design decisions (Container)
Root container for the design decisions posed against the Logical-layer roles. Each names a role with more than one credible solution option, the kinds presented for it, and the Physical-layer trade study that decides between them. The answer is read from the Implement link the trade creates into the requirement from the winning kind in logical/F16A_Logical.slx, and from that winner's Rationale.Justification in physical/F16A_Physical.slx. No weight, score or winner appears in any requirement here by construction: the weights live in each trade script, and the requirement poses the question before any trade answers it, so an outcome stated here would be a claim rather than a record (D-037, D-040).
Keywords: draft, derived, logical, decision

### 1.1 [REQ_F16A_L01] Propulsion: single-engine or twin-engine installation?
The PropulsionSystem role shall be realized by exactly one of the kinds the Logical layer presents for it -- SingleEngine or TwinEngine. The choice is made by the Physical-layer trade study physical/F16AEngineTradeStudy.m, which scores the concrete parameterized engine candidates realizing each kind. This requirement poses the decision and does not contain its answer (D-040).
Rationale: It is worth posing rather than assuming because a twin installation buys engine-out survivability, while a single installation avoids the installed mass and complexity of a duplicated engine and accessory group.
Keywords: draft, derived, logical, decision

### 1.2 [REQ_F16A_L02] Flight control: fly-by-wire or hydro-mechanical?
The FlightControlSystem role shall be realized by exactly one of the kinds the Logical layer presents for it -- FlyByWire or HydroMechanical. The choice is made by the Physical-layer trade study physical/F16AFlightControlsTradeStudy.m, which scores the concrete parameterized flight-control candidates realizing each kind. This requirement poses the decision and does not contain its answer (D-040).
Rationale: It is worth posing rather than assuming because only a control system able to supply artificial stability makes the negative static margin REQ_F16A_025 requires flyable.
Keywords: draft, derived, logical, decision

### 1.3 [REQ_F16A_L03] Airframe: blended cranked-delta or conventional trapezoidal wing?
The Airframe role shall be realized by exactly one of the kinds the Logical layer presents for it -- BlendedCrankedDelta or ConventionalTrapWing. The choice is made by the Physical-layer trade study physical/F16AAirframeTradeStudy.m, which scores the concrete parameterized airframe candidates realizing each kind. This requirement poses the decision and does not contain its answer (D-040).
Rationale: It is worth posing rather than assuming because a blended cranked-delta planform buys high-alpha and sustained-turn performance, while a conventional trapezoidal wing is a better-understood shape carrying less aerodynamic development risk.
Keywords: draft, derived, logical, decision