# Requirement set f16a_physical_derived (R2026a)
Requirements owned and verified at the Physical layer (RFLP P) of the F-16A model. Kept separate from the sizing-derived set (f16a.slreqx), the functional-derived set, and the logical-derived set.

## 1 [REQ_F16A_PHYSICAL] F-16A physical-layer requirements (Container)
Root container for requirements surfaced and verified at the Physical layer, where concrete parts and roll-up analyses exist to measure them.
Keywords: draft, derived, physical

### 1.1 [REQ_F16A_P01] Fuel volume sufficiency
The aircraft shall provide sufficient internal fuel tankage (volume, expressed as fuel-weight capacity) to carry the fuel required to complete the design mission profile (REQ_F16A_001-010), without reliance on external tanks. Verification method: the total available fuel capacity (a roll-up over the internal fuel tanks) shall be greater than or equal to the mission fuel required (from mission analysis).
Rationale: Range/endurance closure depends on carrying enough fuel, and the check belongs at P because it needs concrete tanks to roll up an available capacity from. The mission-fuel side is NaN BY DESIGN (D-042), so this verification is permanently pending and its test fails by design -- a requirement that is traceable and not yet satisfied, which is the state a real programme lives in for most of its life. Do not read the failing test as work outstanding.
Keywords: draft, derived, physical