% Requirement links of F16AStaticMarginVerificationTest.m (R2026a)

% lines 101-108 verifies f16a.slreqx#33
        function testTakeoffStaticMarginIsNegative(testCase)
            % The AFT end of the CG range -- heaviest, full fuel, full stores --
            % and so the LEAST stable end. Stores and fuel sit aft of the CG, so
            % using them moves it forward. EXPECTED TO PASS.
            testCase.verifyThat(testCase.Balance.SM_TO, ...
                testCase.criterionConstraint(), ...
                testCase.criterionMessage("takeoff", testCase.Balance.SM_TO));
        end

% lines 110-120 verifies f16a.slreqx#33
        function testLandingStaticMarginIsNegative(testCase)
            % The FORWARD end: fuel burnt, stores released, and so the MOST
            % stable end. EXPECTED TO FAIL -- SM_land is positive and
            % REQ_F16A_025 is violated. "Across the operational CG range" is
            % what puts this end in scope: checking only takeoff verifies half a
            % requirement and would report this design compliant (D-047
            % guarantee 4).
            testCase.verifyThat(testCase.Balance.SM_land, ...
                testCase.criterionConstraint(), ...
                testCase.criterionMessage("landing", testCase.Balance.SM_land));
        end